# Dynamo graph Dyn_script.dyn (Dynamo 2.16.1.2727)

categories = Categories("OST_StructuralFraming")
all_elements_of_category = ElementsOfCategory(Category=categories)
delete = Element.Delete(element=all_elements_of_category)
